# Grasshopper definition M00_Millipede FEM field.gh (Grasshopper 1.0.7)
# Copyright: Co-de-iT
# plug-ins: Millipede

# supports
slider = Slider(-802.523, range=-1110..1)
mat = Material(MaterialType=2)
# loads
brep = Brep(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)
brep_2 = Brep([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])
mat_2 = MillC_StockSupportType(X=True, Y=True, Z=True, RX=True, RY=True, RZ=True)
# the mesh
# 
# QUAD meshes only!!
mesh = Mesh(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)
load_region = LoadRegion(Boundary=brep, ArealNormalLoad=slider)
support_region = MSupportTypeRegion(Boundary=brep_2, SupportType=mat_2, AmmendExistingSupports=True)
femesh = FEMesh(Meshes=mesh, Material=mat, Thickness=Slider(0.1, range=0..3), AreaLoad=Vector(0, 0, 0), NormalAreaLoad=0)

# ----
# n. of iterations per step. The higher the number, the longer the calculation time before visualization of results
number_slider = Slider(4, range=0..18)

# ----
# Millipede FEM field generation
# 
# get structural information for an FEM mesh in form of a scalar (mesh vertex color) and vector field
# 
# code by Alessio Erioli
# 
# v 0.1
# deactivete-reactivate this to change model
fe_system = FESystem(
    ModelComponents=[femesh, support_region, load_region],
    IntersectAddedCurves=True,
    MergeTolerance=0.0001,
    MinimumCurveSpan=0.05,
    MaximumCurveSpan=10000,
    CurveTolerance=0.1)  # disabled

# ----
# do NOT deactivate-reactivate this component
# Click "step" and wait for calculation. Repeat until a b/w stiffness pattern appears on the mesh.
# 
# The higher the number of repetitions, te more accurate the result
fe_solver = FESolver(
    FEModel=fe_system,
    SelfWeightCoefficient=Slider(0, range=0..1),
    BeamOptimisationIterations=0,
    QuadOptimisationIterations=number_slider,
    OptimizationTarget=Slider(0.15, range=0..1),
    OptimizationPenalization=Slider(2.088, range=0..3),
    LoadCase=0,
    AllCases=True)  # -> FEModel, MaxDeflection, Weight

# ----
# The face order of the Millipede output mesh is not the same of the original input mesh
# 
# USE THE OUTPUT MESH AFTER THE MILLIPEDE PROCESS
panel = Panel("0.0")

# ---- group: mesh results
mesh_visualization = MeshVisualization(FEModel=fe_solver.FEModel, Deflection=panel, Plane=Slider(0, range=-1..1), ShowThickness="false", ColorMode=8)  # -> Mesh, CompleteRange, VisibleRange

# ---- group: extract results
quad_results = QuadResults(FEModel=fe_solver.FEModel, Plane=1)  # -> PrincipalStressFrame, Area, NormalDisplacement, MaxVonMisesStress, PS1, PS2, StiffnessMultiplier, Bending

# ---- group: principal stress planes
pln = Plane(quad_results.PrincipalStressFrame)

# ----
# vector field
deplane = DeconstructPlane(Plane=pln)  # -> Origin, XAxis, YAxis, ZAxis

# ---- group: choose vector field value
vector_field = ValueList({"PStess1": 0, "PStress2": 1}, selected="PStess1")
filter = StreamFilter(Gate=vector_field, Stream0=deplane.XAxis, Stream1=deplane.YAxis)

# ---- group: choose scalar field value
scalar_field = ValueList({"Von Mises Stress": 0, "Principal Stress 1": 1, "Principal Stress 2": 2, "Stiffness": 3, "Bending": 4}, selected="Stiffness")
filter_2 = StreamFilter(
    Gate=scalar_field,
    Stream0=quad_results.MaxVonMisesStress,
    Stream1=quad_results.PS1,
    Stream2=quad_results.PS2,
    Stream3=quad_results.StiffnessMultiplier,
    Stream4=quad_results.Bending)

# ---- group: remap valules on a 0-1 range
num = Number(filter_2)
bnd = Bounds(Numbers=num)
remap = RemapNumbers(Value=num, Source=bnd, Target=Domain(0, 1))  # -> Mapped, Clipped

# ----
devec = DeconstructVector(Vector=filter)  # -> XComponent, YComponent, ZComponent
f_mf2vval = MeshFacesToVerticesValues(M=mesh_visualization.Mesh, Vf=devec.XComponent)  # -> Vv; inputs M: Mesh, Vf: list of Double, m: Boolean
#   port m: calculation method: simple or weighted average
# ---------- f_mf2vval: C# usings ----------
using System.IO;
using System.Linq;
using System.Data;
using System.Drawing;
using System.Reflection;
using System.Windows.Forms;
using System.Xml;
using System.Xml.Linq;
using System.Runtime.InteropServices;

using Rhino.DocObjects;
using Rhino.Collections;
using GH_IO;
using GH_IO.Serialization;
# ---------- f_mf2vval: C# ----------
                                                                                                                                                                                                                                                                    /*
    froGH - a sparse collection of (in)utilities for Grasshopper

    Convert per-Face values into per-Vertex values

    parallelization occurs after 1000 elements

    code by Alessio Erioli

    froGH by Co-de-iT is licensed under a Creative Commons Attribution 4.0 International License.
    http://creativecommons.org/licenses/by/4.0/

    */
    initComp(m);

    int pThres = 10000; // parallelization threshold

    if (M != null && Vf.Count > 0){

      if (Vf.Count == M.Faces.Count){

        List <double> vVerts = new List<double>(); // per-Vertices values

        if (Vf.Count < pThres){

          int[] vFaces;
          double vVal, vD, dists;
          Point3d v;

          for (int i = 0; i < M.Vertices.Count; i++){

            vVal = 0;
            vD = 0;
            dists = 0;

            // get faces shared by vertex
            vFaces = M.Vertices.GetVertexFaces(i);

            // get the values

            if (m){

              // get vertex
              v = (Point3d) M.Vertices[i];

              // _____________________  weighted average method

              for (int j = 0; j < vFaces.Length; j++){

                // get distances from face center
                vD = v.DistanceTo(getFaceCenter(M, j));

                // add weighted value
                vVal += Vf[vFaces[j]] * vD;
                // update sum of distances
                dists += vD;
              }

              // weight average
              vVal /= dists;

              vVerts.Add(vVal);

            }else{

              // _____________________  standard average method

              for (int j = 0; j < vFaces.Length; j++){
                vVal += Vf[vFaces[j]];
              }
              // average
              vVal /= vFaces.Length;

              vVerts.Add(vVal);

            }
          }

          Vv = vVerts;

        }else{

          var mFv = new System.Collections.Concurrent.ConcurrentDictionary<int, double>(Environment.ProcessorCount, Vf.Count);
          List<int> vInd = new List<int>();

          for(int i = 0; i < M.Vertices.Count; i++){
            vInd.Add(i);
          }

          foreach(int i in vInd) mFv[i] = 0; // initialise dictionary

          if(m){

            System.Threading.Tasks.Parallel.ForEach(vInd, i =>
              {
              // weighted average calculation

              Point3d v = (Point3d) M.Vertices[i];
              int[] vFaces = M.Vertices.GetVertexFaces(i);
              double vVal = 0, dists = 0, vD = 0;

              for (int j = 0; j < vFaces.Length; j++){
                // get distances from face center
                vD = v.DistanceTo(getFaceCenter(M, j));

                // add weighted value
                vVal += Vf[vFaces[j]] * vD;
                // update sum of distances
                dists += vD;
              }
              // average
              vVal /= dists;
              mFv[i] = vVal;
              }
              );

            Vv = mFv.Values;

          }else{

            System.Threading.Tasks.Parallel.ForEach(vInd, i =>
              {
              // standard average calculation
              int[] vFaces = M.Vertices.GetVertexFaces(i);
              double vVal = 0;
              for (int j = 0; j < vFaces.Length; j++){
                vVal += Vf[vFaces[j]];
              }
              // average
              vVal /= vFaces.Length;
              mFv[i] = vVal;
              }
              );

            Vv = mFv.Values;
          }
        }
      }
    }
# ---------- f_mf2vval: C# additional code ----------
  void initComp(bool m){
    Component.Name = "Mesh Faces to Vertices values";
    Component.NickName = "f_MF2VVal";
    Component.Description = "Converts per-face into per-vertex values";
    Component.Message = m ? "weighted" : "simple";
    Component.Params.Input[0].Name = "Mesh";
    Component.Params.Input[0].Description = "Input Mesh";
    Component.Params.Input[1].Name = "Values per faces";
    Component.Params.Input[1].Description = "List of values (one for each face)";
    Component.Params.Input[2].Name = "Method";
    Component.Params.Input[2].Description = "calculation method:\nsimple or weighted average";
    Component.Params.Output[0].Name = "Values per vertices";
    Component.Params.Output[0].Description = "Values distributed per vertices";
  }


  public Point3d getFaceCenter(Mesh M, int fInd){
    MeshFace f = M.Faces[fInd];
    Point3d c = new Point3d();
    if (f.IsValid(M.Vertices.Count)){
      c = Point3d.Add(c, (Point3d) M.Vertices[f.A]);
      c = Point3d.Add(c, (Point3d) M.Vertices[f.B]);
      c = Point3d.Add(c, (Point3d) M.Vertices[f.C]);
      if (f.IsQuad){
        c = Point3d.Add(c, (Point3d) M.Vertices[f.D]);
      }
    }
    c /= f.IsQuad ? 4 : 3;
    return c;
  }
# ---------- end f_mf2vval ----------
f_mf2vval_2 = MeshFacesToVerticesValues(M=mesh_visualization.Mesh, Vf=devec.YComponent)  # -> Vv; inputs M: Mesh, Vf: list of Double, m: Boolean; same code as f_mf2vval
f_mf2vval_3 = MeshFacesToVerticesValues(M=mesh_visualization.Mesh, Vf=devec.ZComponent)  # -> Vv; inputs M: Mesh, Vf: list of Double, m: Boolean; same code as f_mf2vval
f_mf2vval_4 = MeshFacesToVerticesValues(M=mesh_visualization.Mesh, Vf=remap.Mapped)  # -> Vv; inputs M: Mesh, Vf: list of Double, m: Boolean; same code as f_mf2vval
demesh = DeconstructMesh(Mesh=mesh_visualization.Mesh)  # -> Vertices, Faces, Colours, Normals
vec = VectorXYZ(XComponent=f_mf2vval, YComponent=f_mf2vval_2, ZComponent=f_mf2vval_3)  # -> Vector, Length

# ----
# display scalar values
min_sphere_size = Slider(0.1, range=0..5)
max_sphere_size = Slider(0.656, range=0..20)
facen = FaceNormals(Mesh=mesh_visualization.Mesh)  # -> Centers, Normals
dom = Domain(DomainStart=min_sphere_size, DomainEnd=max_sphere_size)
f_mf2vval_5 = MeshFacesToVerticesValues(M=mesh_visualization.Mesh, Vf=remap.Mapped)  # -> Vv; inputs M: Mesh, Vf: list of Double, m: Boolean; same code as f_mf2vval

unit = UnitVector(Vector=vec.Vector)

line = LineSDL(Start=demesh.Vertices, Direction=unit, Length=Slider(1, range=0..10))

gradient = Gradient(LowerLimit=0, UpperLimit=1, Parameter=f_mf2vval_4, stops=[0: RGB(0, 0, 0), 1: RGB(255, 255, 255)])

# ---- group: result by vertex
resolution = ValueList({"coarse": 0, "fine": 1, "extra fine": 2}, selected="fine")
remap_2 = RemapNumbers(Value=f_mf2vval_5, Source=Domain(0, 1), Target=dom)  # -> Mapped, Clipped
fastdotdis = DotDisplayFast(point=demesh.Vertices, radius=remap_2.Mapped, resolution=resolution)

# ---- group: results by face
resolution_2 = ValueList({"coarse": 0, "fine": 1, "extra fine": 2}, selected="fine")
remap_3 = RemapNumbers(Value=remap.Mapped, Source=Domain(0, 1), Target=dom)  # -> Mapped, Clipped
fastdotdis_2 = DotDisplayFast(point=facen.Centers, radius=remap_3.Mapped, resolution=resolution_2)

# ----
# display vector field
vdisex = VectorDisplayEx(Point=demesh.Vertices, Vector=unit, Colour=RGB(0, 0, 0), Width=2)

# ----
# internalize data + copy/paste
# (or bake to Rhino):
# vector field as lines
# colored mesh from Millipede
# re-colored mesh by Millipede results
# scalar field values in 0-1 range
conmesh = ConstructMesh(Vertices=demesh.Vertices, Faces=demesh.Faces, Colours=gradient)
crv = Curve(line)
num_2 = Number(f_mf2vval_4)
mesh_2 = Mesh(mesh_visualization.Mesh)

# ==== cluster DotDisplayFast: like Dot Display, but faster (black dots only)
radius = ClusterInput()
point = ClusterInput()
resolution = ClusterInput()  # 0 = coarse, 1 = fine, 2 = extra-fine
filter = StreamFilter(Gate=resolution, Stream0="5", Stream1="10", Stream2="20")
material = CreateMaterial(Diffuse="black", Specular="black", Emission="black", Transparency=0, Shine=0)
msphere = MeshSphere(Base=point, Radius=radius, UCount=filter, VCount=filter)
mjoin = MeshJoin(Meshes=msphere)
preview = CustomPreview(Geometry=mjoin, Shader=material)
