# Grasshopper definition 20160411_respawn + stratification.gh (Grasshopper 1.0.7)
# Copyright: Co-de-iT
# plug-ins: MarchingCubes, Anemone

mesh = Mesh(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)
mesh_2 = Mesh(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)
# <title>
# 
# <description>
# 
# code by <author>
# 
# v <version>
# 
# © Co-de-iT 2016 _ Creative Commons Attribution-NonCommercial-ShareAlike 4.0 International License
# reciproCITY
# respawn: Agents differ from paticles in one very important characteristic: they can store internal states.
# 
# Under certain conditions, agents can "die" (become inactive) and, at will, be "respawned". The logic is as follows:
# 
# . use a flag to store the alive/dead agent state
# . if dead ignore
# . if alive, check for respawn condition
# . if so, change state from alive to dead and generate a new one
# . else, update agent
# tutors
# Aldo Sollazzo
# Alessio Erioli
# IaaC . 15-17.04.2016
# agents
facen = FaceNormals(Mesh=mesh)  # -> Centers, Normals
reduction_factor = Slider(0.944, range=0..1)
# field
reduction_factor_2 = Slider(0.944, range=0..1)
demesh = DeconstructMesh(Mesh=mesh)  # -> Vertices, Faces, Colours, Normals
lng = ListLength(List=facen.Centers)
lng_2 = ListLength(List=demesh.Vertices)
multiplication = Multiplication(A=lng_2, B=reduction_factor_2)
multiplication_2 = Multiplication(A=lng, B=reduction_factor)
reduce = RandomReduce(List=facen.Centers, Reduction=multiplication_2, Seed=1)
reduce_2 = RandomReduce(List=demesh.Vertices, Reduction=multiplication, Seed=1)

number_slider = Slider(13, range=1..20)
expression = Expression(x=number_slider, Expression="Format(\"{{<{0}}}\", x)")
pt = Point(simplify(graft(reduce)))
pt_2 = Point(Point(0, 0, 0))
split = SplitTree(Data=pt, Masks=flatten(expression))  # -> Positive, Negative
viewer = ParamViewer(split.Negative)
dpath = DeconstructPath(Branch=viewer)  # -> flatten(Indices)
expression_2 = Expression(x=dpath, Expression="Format(\"{{{0}}}\", x)")
addition = Addition(A=dpath, B=1)  # -> flatten(Result)
replace = ReplacePaths(Data=pt_2, Search="{*}", Replace=number_slider)
# insert branch in data tree
replace_2 = ReplacePaths(Data=split.Negative, Search=expression_2, Replace=addition)
merge = Merge(Data1=split.Positive, Data2=replace, Data3=replace_2)

medges = MeshEdges(Mesh=mesh)  # -> NakedEdges, InteriorEdges, NonManifoldEdges
repeat = RepeatData(Data="0", Length=lng_2)
lng_3 = ListLength(List=reduce)
# flag point
# use points as boolean flags: groups take only geometry so we use geometry as information
# 
# 0,0,1 > agent is alive
# 0,0,0 > agent is dead
pt_3 = Point(Point(0, 0, 1))
fspin = SpinForce(Plane=reduce_2, Strength=Slider(20, range=0..20), Radius=Slider(13.2, range=0..30), Decay=2)
repeat_2 = RepeatData(Data=pt_3, Length=lng_3)
mergef = MergeFields(Fields=fspin)
# show boundaries
join = JoinCurves(Curves=medges.NakedEdges, Preserve=False)

data = Data()
data_2 = Data()
# append branch  to data tree
tstat = TreeStatistics(Tree=data)  # -> Paths, Length, Count
replace_3 = ReplacePaths(Data=data_2, Search="{*}", Replace=tstat.Count)
merge_2 = Merge(Data1=data, Data2=replace_3)

# ----
# in order to pass the trajectory as a polyline we must generate a line by using a dummy first point (that will be culled after the loop).
ln = Line(StartPoint=pt_3, EndPoint=reduce)
evf = EvaluateField(Field=mergef, Point=demesh.Vertices)  # -> Tensor, Strength
bnd = Bounds(Numbers=evf.Strength)
dom = ConstructDomain(DomainStart=Slider(1.089, range=0..5), DomainEnd=Slider(4.462, range=0..5))
# . agent location
# . alive/dead status
# . trajectory as polyline
merge_3 = Merge(Data1=simplify(graft(reduce)), Data2=simplify(graft(repeat_2)), Data3=simplify(graft(ln)))
remap = RemapNumbers(Value=evf.Strength, Source=bnd, Target=dom)  # -> Mapped, Clipped
amp = Amplitude(Vector=evf.Tensor, Amplitude=remap.Mapped)
group = Group(Objects=merge_3)  # -> simplify(Group)
velocity = Slider(2.33, range=0..10)
level_height = Slider(0.3, range=0..1)
number_slider_2 = Slider(50, range=0..1000)
button = Button()
exit = Button()
vdisex = VectorDisplayEx(Point=demesh.Vertices, Vector=amp, Colour=RGB(0, 0, 0), Width=1)
loop_start = LoopStart(N=number_slider_2, T=button, particles=group, strata=repeat)  # -> port, Counter, Particles, Strata; disabled
ungroup = Ungroup(Group=loop_start.Particles)
expression_3 = Expression(x=loop_start.Counter, y=number_slider_2, Expression="Format(\"{0} %\",round(x/y*100,1))")
# loc
# alive?
# trail as polyline
item = ListItem(List=ungroup, Index=0, Wrap=True)  # -> Item, Item1, Item2
panel = Panel(expression_3)

# ---- group: is agent alive?
pdecon = Deconstruct(Point=item.Item1)  # -> XComponent, YComponent, ZComponent
dispatch = Dispatch(List=item.Item2, DispatchPattern=pdecon.ZComponent)  # -> ListA, ListB
dispatch_2 = Dispatch(List=item.Item, DispatchPattern=pdecon.ZComponent)  # -> ListA, ListB
dispatch_3 = Dispatch(List=item.Item1, DispatchPattern=pdecon.ZComponent)  # -> ListA, ListB

# ---- group: respawn check
meshcp = MeshClosestPoint(Point=dispatch_2.ListA, Mesh=mesh)  # -> Point, Index, Parameter
crv_cp = CurveClosestPoint(Point=graft(meshcp.Point), Curve=join)  # -> Point, Parameter, Distance
edge_thres = Slider(1.5, range=0..10)
sort = SortList(Keys=crv_cp.Distance)  # -> Keys, ValuesA
item_2 = ListItem(List=sort.Keys, Index=0, Wrap=True)
smaller = SmallerThan(FirstNumber=item_2, SecondNumber=edge_thres)  # -> SmallerThan, simplify(OrEqualTo)
dispatch_4 = Dispatch(List=dispatch_2.ListA, DispatchPattern=smaller.OrEqualTo)  # -> ListA, ListB
dispatch_5 = Dispatch(List=dispatch_3.ListA, DispatchPattern=smaller.OrEqualTo)  # -> ListA, ListB
dispatch_6 = Dispatch(List=dispatch.ListA, DispatchPattern=smaller.OrEqualTo)  # -> ListA, ListB

# ---- group: update
clean = CleanTree(RemoveNulls=True, RemoveInvalid=True, RemoveEmpty=True, Tree=dispatch_4.ListB)
clean_2 = CleanTree(RemoveNulls=True, RemoveInvalid=True, RemoveEmpty=True, Tree=dispatch_5.ListB)
clean_3 = CleanTree(RemoveNulls=True, RemoveInvalid=True, RemoveEmpty=True, Tree=dispatch_6.ListB)
explode = Explode(Curve=clean_3, Recursive=True)  # -> Segments, Vertices
panel_2 = Panel("1")

# ---- group: update / move (field)
evf_2 = EvaluateField(Field=mergef, Point=clean)  # -> Tensor, Strength
amp_2 = Amplitude(Vector=evf_2.Tensor, Amplitude=velocity)
move = Move(Geometry=clean, Motion=amp_2)  # -> Geometry, Transform

# ---- group: update / Closest Vertex
cp = ClosestPoint(Point=move.Geometry, Cloud=demesh.Vertices)  # -> ClosestPoint, CPIndex, Distance

# ---- group: update / Update Strata
item_3 = ListItem(List=flatten(loop_start.Strata), Index=cp.CPIndex, Wrap=True)
addition_2 = Addition(A=item_3, B=panel_2)

# ---- group: update / normal vector
item_4 = ListItem(List=demesh.Normals, Index=cp.CPIndex, Wrap=True)

# ---- group: update / Height
amp_3 = Amplitude(Vector=item_4, Amplitude=level_height)

# ---- group: update / constrain to mesh and add to trajectory
multiplication_3 = Multiplication(A=amp_3, B=addition_2)
meshcp_2 = MeshClosestPoint(Point=move.Geometry, Mesh=mesh)  # -> Point, Index, Parameter
move_2 = Move(Geometry=meshcp_2.Point, Motion=multiplication_3)  # -> simplify(Geometry), Transform
merge_4 = Merge(Data1=simplify(explode.Vertices), Data2=simplify(move_2.Geometry))
pline = PolyLine(Vertices=merge_4, Closed=False)

# ----
lng_4 = ListLength(List=flatten(dispatch_5.ListA))
pt_4 = Point(Point(0, 0, 0))
repeat_3 = RepeatData(Data=pt_4, Length=lng_4)  # -> flatten(Data)
pt_5 = Point(flatten(dispatch_4.ListA))
crv = Curve(flatten(dispatch_6.ListA))
merge_5 = Merge(Data1=graft(pt_5), Data2=graft(repeat_3), Data3=graft(crv))
# killed agents
group_2 = Group(Objects=merge_5)  # -> flatten(Group)

merge_6 = Merge(Data1=dispatch_2.ListB, Data2=dispatch_3.ListB, Data3=dispatch.ListB)
clean_4 = CleanTree(RemoveNulls=True, RemoveInvalid=True, RemoveEmpty=Toggle(True), Tree=merge_6)
# inactive agents
group_3 = Group(Objects=clean_4)  # -> flatten(Group)

merge_7 = Merge(Data1=simplify(move.Geometry), Data2=simplify(clean_2), Data3=simplify(pline))
# updated agents
group_4 = Group(Objects=merge_7)  # -> flatten(Group)

replace_4 = ReplaceItems(List=loop_start.Strata, Item=flatten(addition_2), Indices=flatten(cp.CPIndex), Wrap=False)
radius = Slider(2, range=0..100)
number_slider_3 = Slider(1, range=0.3..10)
multiplication_4 = Multiplication(A=replace_4, B=level_height)
dist = Slider(3, range=0..5)
amp_4 = Amplitude(Vector=demesh.Normals, Amplitude=multiplication_4)
bnd_2 = Bounds(Numbers=replace_4)
gradient = Gradient(
    LowerLimit=0,
    UpperLimit=bnd_2,
    Parameter=replace_4,
    stops=[0: RGB(234, 38, 0), 0.25: RGB(234, 126, 0), 0.5: RGB(254, 244, 84), 0.75: RGB(173, 203, 249)])
move_3 = Move(Geometry=demesh.Vertices, Motion=amp_4)  # -> Geometry, Transform

execute = BooleanToggle(False)

# ----
# display strata
orient2cam = OrientToCamera(Pt=move_3.Geometry, refresh=Button())  # -> out, A; inputs Pt: Point3d, refresh: Boolean
# ---------- orient2cam: C# ----------
    Plane p;
    String eol = Environment.NewLine;
    Component.Name = "Orient to Camera";
    Component.NickName = "Orient2Cam";
    Component.Message = "v0.1 _ by Alessio Erioli" + eol + "Co-de-iT";
    Component.Description = "Creates a plane on the input point aligned with current camera";


    if (RhinoDoc.ActiveDoc.Views.ActiveView.ActiveViewport.GetCameraFrame(out p)){
      A = new Plane(new Point3d(Pt.X, Pt.Y, Pt.Z), p.XAxis, p.YAxis);
    }
# ---------- end orient2cam ----------
tag = TextTag3D(Location=orient2cam.A, Text=replace_4, Size=1, Colour=gradient, Justification=7)
vdisex_2 = VectorDisplayEx(Point=demesh.Vertices, Vector=amp_4, Colour=gradient, Width=Slider(1, range=1..3))

# ---- group: respawn
subtraction = Subtraction(A=lng_2, B="1")
lng_5 = ListLength(List=flatten(dispatch_4.ListA))
random = Random(Range=subtraction, Number=lng_5, Seed=loop_start.Counter, Integers=True)
item_5 = ListItem(List=demesh.Vertices, Index=random, Wrap=True)  # -> flatten(Item)
lng_6 = ListLength(List=item_5)
pt_6 = Point(Point(0, 0, 1))
repeat_4 = RepeatData(Data=pt_6, Length=lng_6)  # -> flatten(Data)

# ----
ln_2 = Line(StartPoint=pt_6, EndPoint=item_5)  # -> flatten(Line)

# ---- group: respawn (continued)
merge_8 = Merge(Data1=simplify(graft(item_5)), Data2=simplify(graft(repeat_4)), Data3=simplify(graft(ln_2)))
# respawned agents
group_5 = Group(Objects=merge_8)  # -> flatten(Group)

# ----
merge_9 = Merge(Data1=group_3, Data2=group_5, Data3=group_2, Data4=group_4)  # -> simplify(graft(Result))
loop_end = LoopEnd(
    port=loop_start.port,
    Exit=exit,
    Particles=simplify(merge_9),
    Strata=simplify(replace_4),
    TimeOutVal=0,
    pausedState=False,
    state="Constant output")  # -> particles, strata
ungroup_2 = Ungroup(Group=loop_end.particles)
item_6 = ListItem(List=ungroup_2, Index=0, Wrap=True)  # -> Item, Item1, Item2
explode_2 = Explode(Curve=item_6.Item2, Recursive=True)  # -> Segments, Vertices
cull_i = CullIndex(List=explode_2.Vertices, Indices=0, Wrap=True)
pline_2 = PolyLine(Vertices=cull_i, Closed=False)
clean_5 = CleanTree(RemoveNulls=True, RemoveInvalid=True, RemoveEmpty=True, Tree=pline_2)
smoothpline = SmoothPolyline(Polyline=clean_5, Strength=1, Times=Slider(5, range=1..30))  # -> flatten(Polyline)

dam = DataDam(DataA=smoothpline, BufferDelay=10000000, BufferMode=0)

crv_2 = Curve(dam)
# remember to
# clean tree before
# using the connect
# component!!
explode_3 = Explode(Curve=dam, Recursive=True)  # -> Segments, Vertices
lng_7 = ListLength(List=explode_3.Vertices)
range = Range(Domain=Domain(0, 1), Steps=lng_7)
graph = GraphMapper(range, x0=0, x1=1, y0=0, y1=1, container_name="Sine", Equation_px=[0, 0.4983883202], Equation_py=[0.702873826, 1])
graph_2 = GraphMapper(
    range,
    x0=0,
    x1=1,
    y0=0,
    y1=1,
    container_name="Bezier",
    cpx=[0, 0.3913043439, 0.6086956263, 1],
    cpy=[0.3695651889, 1, 1, 0.3913043737])
dam_2 = DataDam(DataA=explode_3.Vertices, BufferDelay=10000000, BufferMode=0)
# isomesh
cluster = Cluster(C=flatten(crv_2), B=number_slider_3)  # -> cell_n, bounding_box_edges

curve_charge = CurveCharge(Curve=graft(crv_2), Radius=radius, ChargeStrengths=graph)
execute_2 = BooleanToggle(False)
cocoon = Cocoon(Charges=flatten(curve_charge), Iso=Slider(0.5, range=0.01..1), CellSize=number_slider_3, Execute=execute_2, Simple=False)  # -> Mesh, RefinementData; disabled
# replace with Dendro components
refine = Refine(
    RefinementData=cocoon.RefinementData,
    Samples=Slider(1, range=1..10),
    SampleSize=Slider(0.5, range=0..1),
    SampleTolerance=Slider(0.25, range=0..1),
    LaplacianSmoothing=Slider(1, range=1..10),
    ValencePasses=Slider(2, range=1..10),
    SubD=Slider(1, range=0..10),
    Execute=execute)

n_of_cells_along_largest_size = Panel(cluster.cell_n)
# connect structure
# warning - SLOW
cptree = ConnectPointTree(d=dist, Ptree=dam_2)  # -> out, P; inputs d: Double, Ptree: tree of Point3d
# ---------- cptree: C# usings ----------
using System.IO;
using System.Linq;
using System.Data;
using System.Drawing;
using System.Reflection;
using System.Windows.Forms;
using System.Xml;
using System.Xml.Linq;
using System.Runtime.InteropServices;

using Rhino.DocObjects;
using Rhino.Collections;
using GH_IO;
using GH_IO.Serialization;
# ---------- cptree: C# ----------
    String eol = Environment.NewLine;
    Component.Name = "Connect Point tree";
    Component.NickName = "CPtree";
    Component.Message = "v0.1 _ by Alessio Erioli" + eol + "Co-de-iT";
    Component.Description = "Connects points in a tree" + eol + " excluding their own branch" + eol +
      "d - distance threshold";
    /*
    System.Threading.Tasks.Parallel.ForEach(Ptree.AllData(), p => {
    });
    */

    Point3d p, p1;

    // System.Collections.Concurrent.ConcurrentBag<Line> conn = new System.Collections.Concurrent.ConcurrentBag<Line>();
    DataTree<Point3d> conT = new DataTree<Point3d> ();

    //List <Line> conn = new List<Line>();
    GH_Path pa;
    //System.Threading.Tasks.Parallel.For(0, Ptree.BranchCount, i => {
    for (int i = 0; i < Ptree.BranchCount; i++){
      for(int r = 0; r < Ptree.Branch(i).Count; r++){
        p = Ptree.Branch(i)[r];
        pa = new GH_Path(new int[]{i,r});
        conT.EnsurePath(pa);
        for (int j = i + 1; j < Ptree.BranchCount; j++){
          for(int k = 0; k < Ptree.Branch(j).Count(); k++){
            p1 = Ptree.Branch(j)[k];
            if (p.DistanceTo(p1) < d){
              conT.Add(p1, pa);
              //conn.Add(new Line(p, p1));
            }
          }
        }
      }
    }
    //  });
    P = conT;
# ---------- end cptree ----------
ln_3 = Line(StartPoint=simplify(graft(dam_2)), EndPoint=cptree.P)
preview = CustomPreview(
    Geometry=ln_3,
    Shader={diffuse=RGB(255, 105, 180), emission=RGB(76, 32, 54), shine=0.5, specular=RGB(255, 255, 255), transparency=0})

# ==== cluster Cluster
C = ClusterInput()
bbox = BoundingBox(Content=C, Plane=PlaneXY(0, 0, 0), UnionBox=True)  # -> Box, Box_2
boxprop = BoxProperties(Box=bbox.Box)  # -> Center, Diagonal, Area, Volume, Degeneracy
edges = BrepEdges(Brep=bbox.Box)  # -> Naked, Interior, NonManifold
devec = DeconstructVector(Vector=boxprop.Diagonal)  # -> XComponent, YComponent, ZComponent
expression = Expression(x=devec.XComponent, y=devec.YComponent, z=devec.ZComponent, Expression="if(x>y, if(x>z,x,z),if(y>z,y,z))")
B = ClusterInput()
division = Division(A=expression, B=B)
int = Integer(division)
cell_n = ClusterOutput(int)
bounding_box_edges = ClusterOutput(edges.Interior)
