# Grasshopper definition XX_align planes - code.gh (Grasshopper 1.0.7)
# Copyright: Co-de-iT
# plug-ins: CurlNoise, FileToScript, IntraLattice, DendroGH

subdir = Panel("Agent_Bodies\Agent_Bodies")
cs_file_to_sync = Panel("Align Planes-begin.cs")
dir_type = ValueList({"desktop": 0, "documents": 1, "GH file path": 2, "C:": 3}, selected="GH file path")
n_of_planes = Slider(3000, range=10..5000)
box = Box({Plane=Plane(origin=(0, 0, 0), x=(0, 1, 0), y=(1, 0, 0)), X=Domain(0, 10), Y=Domain(0, 10), Z=Domain(-10, 0)})
f_pathg = PathGenerator(type=dir_type, subDir=subdir)  # -> dir; inputs type: Int32, subDir: String
# ---------- f_pathg: C# ----------
                           /*
    froGH - a sparse collection of (in)utilities for Grasshopper

    Path Generator
    code by Alessio Erioli - value list generation based on code by James Ramsden

    froGH by Co-de-iT is licensed under a Creative Commons Attribution 4.0 International License.
    http://creativecommons.org/licenses/by/4.0/

    */
    initComp();


    String S = "";
    String root = "";
    String end = "\\";
    String eol = Environment.NewLine;

    // __________________ autoList part __________________

    // variable for the list
    Grasshopper.Kernel.Special.GH_ValueList vList;
    // tries to cast input as list
    try{

      // if the list is not the first parameter then change Input[0] to the corresponding value
      vList = (Grasshopper.Kernel.Special.GH_ValueList) Component.Params.Input[0].Sources[0];
      // Print("value list connected");
      // check if the list must be created
      //if (vList.NickName != "dir type"){
      if (!vList.NickName.Equals("dir type")){
        vList.ClearData();
        vList.ListItems.Clear();
        vList.NickName = "dir type";
        var item1 = new Grasshopper.Kernel.Special.GH_ValueListItem("desktop", "0");
        var item2 = new Grasshopper.Kernel.Special.GH_ValueListItem("documents", "1");
        var item3 = new Grasshopper.Kernel.Special.GH_ValueListItem("GH file path", "2");
        var item4 = new Grasshopper.Kernel.Special.GH_ValueListItem("C:", "3");
        vList.ListItems.Add(item1);
        vList.ListItems.Add(item2);
        vList.ListItems.Add(item3);
        vList.ListItems.Add(item4);

        vList.ListItems[0].Value.CastTo(out type);
      }
    }
    catch{
      // handles anything that is not a value list
    }


    switch(type){
      case 0:
        root = Environment.GetFolderPath(Environment.SpecialFolder.Desktop) + end;
        S = "Desktop";
        break;
      case 1:
        root = Environment.GetFolderPath(Environment.SpecialFolder.MyDocuments) + end;
        S = "Documents";
        break;
      case 2:
        GH_Document ghDoc = owner.OnPingDocument();

        if (ghDoc.IsFilePathDefined)
        {
          int nameLen = ghDoc.DisplayName.TrimEnd('*').Length + 3; // +3 accounts for the '.gh' extension
          int fileLen = ghDoc.FilePath.TrimEnd('*').Length;

          //F = ghDoc.DisplayName.TrimEnd('*');
          root = ghDoc.FilePath.Substring(0, fileLen - nameLen);
          //root = gh_d.FilePath;
          S = "GH File path";
        }
        else
        {
          Print("No path defined. Saving to Desktop until then");
          root = Environment.GetFolderPath(Environment.SpecialFolder.Desktop);
          S = "Desktop";
        }
        break;
      case 3:
        root = "C:" + end;
        S = root + end;
        break;
    }
    dir = root + (subDir != null ? (subDir + end) : "");
    Component.Message = S;
# ---------- f_pathg: C# additional code ----------
  void initComp(){
    Component.Name = "Path Generator";
    Component.NickName = "f_PathG";
    Component.Description = "generates a path based on local direcories such as Desktop, Documents, GH file path";
    Component.Params.Input[0].Name = "dir type";
    Component.Params.Input[0].Description = "directory type: 0 desktop, 1 documents, 2 GH file path, 3 C:\nconnect a value list for automatic list generation";
    Component.Params.Input[1].Name = "custom subdir";
    Component.Params.Input[1].Description = "(optional) custom subdirectory";
  }
# ---------- end f_pathg ----------
_3d = BooleanToggle(True)
number_slider = Slider(0.6, range=0..1)
number_slider_2 = Slider(0.121, range=0..1)
random_vector = CSharpScript(n=n_of_planes, seed=Slider(0, range=0..100), DDD=_3d)  # -> out, V; inputs n: Int32, seed: Int32, DDD: Boolean
# ---------- random_vector: C# usings ----------
using System.IO;
using System.Linq;
using System.Data;
using System.Drawing;
using System.Reflection;
using System.Windows.Forms;
using System.Xml;
using System.Xml.Linq;
using System.Runtime.InteropServices;

using Rhino.DocObjects;
using Rhino.Collections;
using GH_IO;
using GH_IO.Serialization;
# ---------- random_vector: C# ----------
    if(seed == 0) rnd = new Random(); else rnd = new Random(seed);
    List <Vector3d> vectors = new List<Vector3d>();
    Vector3d vec = new Vector3d();
    for (int i = 0; i < n; i++){
      vec.X = rnd.NextDouble() - 0.5;
      vec.Y = rnd.NextDouble() - 0.5;
      vec.Z = DDD ? rnd.NextDouble() - 0.5 : 0;
      vec.Unitize();
      vectors.Add(vec);
    }
    V = vectors;
# ---------- random_vector: C# additional code ----------
  Random rnd;
# ---------- end random_vector ----------
concat = Concatenate(FragmentA=f_pathg, FragmentB=cs_file_to_sync)

# ---- group: volumetric grid
c_script = CSharpScript(B=box, n=Slider(30, range=0..100))  # -> out, A; inputs B: Brep, n: Int32
# ---------- c_script: C# ----------
    BoundingBox b1 = B.GetBoundingBox(false);

    DataTree<Point3d> pts = new DataTree<Point3d>();
    GH_Path path;

    double step = 1.0 / (double) n;

    for (int i = 0; i < n + 1; i++)
      for (int j = 0; j < n + 1; j++)
      {
        path = new GH_Path(i, j);
        for (int k = 0; k < n + 1; k++)
          pts.Add(b1.PointAt(i * step, j * step, k * step));
      }

    A = pts;
# ---------- end c_script ----------

# ----
pop3d = Populate3D(Region=box, Count=n_of_planes, Seed=1)
curl = CurlNoise(Points=c_script.A, Scale=number_slider_2, Offset=number_slider, _3D="true")  # -> CurlVector, Colour
panel = Panel("""<title>

<description>

code by <author>

v <version>""")
plane_radius = Slider(0.5, range=0..1)
amp = Amplitude(Vector=curl.CurlVector, Amplitude=Slider(0.25, range=0..1))
max_force = Slider(0.5, range=0..1)
# P - points
# V - vectors (initial directions)
# cNs - curl noise scale
# cNT - curl noise time
# pR - plane Radius
# cI - cohesion Intensity
# aI - alignment Intensity
# sI - separation Intensity
# fI field Intensity
# mF - maxForce
panel_2 = Panel("1")
pt = Point(pop3d)
vec = Vector(random_vector.V)

# ---- group: field preview
vdisex = VectorDisplayEx(Point=c_script.A, Vector=amp, Colour=curl.Colour, Width=panel_2)

# ----
path = FilePath(concat)

# ---- group: orient planes
c_script_2 = CSharpScript(
    reset=Button(),
    on=Toggle(False),
    P=pt,
    V=vec,
    cNS=number_slider_2,
    cNT=number_slider,
    pR=plane_radius,
    cI=Slider(0.05, range=0..1),
    aI=Slider(0, range=0..1),
    sI=Slider(10, range=0..10),
    fI=Slider(0.985, range=0..1),
    mF=max_force,
    Reference="C:\Users\Alessio\AppData\Roaming\Grasshopper\Libraries\SimplexNoise.dll")  # -> out, Planes, MeshPlanes; inputs reset: Boolean, on: Boolean, P: list of Point3d, V: list of Vector3d, cNS: Double, cNT: Double, pR: Double, cI: Double, aI: Double, sI: Double, fI: Double, mF: Double; disabled
# ---------- c_script_2: C# usings ----------
 
using System.Threading;
using System.Threading.Tasks;
using System.Collections.Concurrent;
using System.Drawing;
using SimplexNoise;
# ---------- c_script_2: C# ----------
 

        // align planes with field - C#
        // code by Alessio Erioli - (c) Co-de-iT 2019 
        //  implementations:
        //  . fixed pts and dirs (for future modularization of the process over larger number of units
        //  . field as static set of pts and vectors (RTree searchable)


        if (P == null || P.Count == 0) return;

        if (reset || aPS == null)
        {
            // passing the essential parameters to the new simulation
            aPS = new AgentPlaneSimulation(P, V);
            //aPS = new AgentPlaneSimulation(P, V, cNS, cNT, pR, cI, aI, sI, fI, mF);

            // initializing arrays for export
            gP = new GH_Plane[aPS.agentPlanes.Length];
            gM = new GH_Mesh[aPS.agentPlanes.Length];
        }
        else
        {
            // update parameters
            aPS.cNS = cNS;
            aPS.cNT = cNT;
            aPS.pR = pR;
            aPS.cI = cI;
            aPS.aI = aI;
            aPS.sI = sI;
            aPS.fI = fI;
            aPS.mF = mF;

            // run simulation
            aPS.Run();

            // extract output geometries and information

            Parallel.For(0, aPS.agentPlanes.Length, i =>
            {
                // extract planes
                gP[i] = new GH_Plane(aPS.agentPlanes[i].PlaneOut());
                // extract meshes (optional)
                //gM[i] = new GH_Mesh(aPS.agentPlanes[i].MeshOut(pR));
            });


            Planes = gP;
            // MeshPlanes = gM;

            if (on) Component.ExpireSolution(true); // equivalent to a timer
        }
# ---------- c_script_2: C# additional code ----------
 

    // ............................................................ global variables 
    // declaring global variables for geometry output
    public GH_Plane[] gP;
    public GH_Mesh[] gM;
    public AgentPlaneSimulation aPS;

    // .................................................................... classes 
    // .............................................................................
    // .............................................................................



    // ...................................................... Simulation ..........
    // ............................................................................
    // ............................................................................

    public class AgentPlaneSimulation
    {
        // ..........................    fields

        public double cNS;
        public double cNT;
        public double pR;
        public double cI;
        public double aI;
        public double sI;
        public double fI;
        public double mF;

        public AgentPlane[] agentPlanes;

        // ..........................    constructor

        public AgentPlaneSimulation(List<Point3d> P, List<Vector3d> V, double cNS, double cNT, double pR, double cI, double aI, double sI, double fI, double mF)
        {

            this.cNS = cNS;
            this.cNT = cNT;
            this.pR = pR;
            this.cI = cI;
            this.aI = aI;
            this.sI = sI;
            this.fI = fI;
            this.mF = mF;

            // build agent planes array
            agentPlanes = new AgentPlane[P.Count];

            Parallel.For(0, P.Count, i =>
            {
                agentPlanes[i] = new AgentPlane(P[i], V[i], this);
            });

        }

        public AgentPlaneSimulation(List<Point3d> P, List<Vector3d> V)
        {
            // build agent planes array
            agentPlanes = new AgentPlane[P.Count];

            Parallel.For(0, P.Count, i =>
            {
                agentPlanes[i] = new AgentPlane(P[i], V[i], this);
            });

        }

        // ..........................    methods

        public void Run()
        {
            UpdateAgents();
        }

        public void UpdateAgents()
        {

            // . . . . . . . . . . environmental and stigmergic interactions
            

            // calculate field influence vector for agents

            Vector3d[] curlNoiseVector = new Vector3d[agentPlanes.Length];

            var p = Partitioner.Create(0, agentPlanes.Length);

            Parallel.ForEach(p, (range, loopState) =>
            {
                for (int i = range.Item1; i < range.Item2; i++)
                {
                    // calculate curl noise vector
                    CurlNoise(agentPlanes[i].O, cNS, cNT, true, out curlNoiseVector[i]);
                    curlNoiseVector[i].Unitize();

                    // this resets the acceleration (or desired direction)
                    // in case a different update sequence is implemented
                    // remember to reset desired before calculating the new iteration
                    agentPlanes[i].ResetDesired();
                    agentPlanes[i].ComputeFieldAlign(curlNoiseVector[i], fI);
                }

            });

            // . . . . . . . . . . peer-to-peer interaction
            FLockRTree();

            // . . . . . . . . . . update position and direction
            UpdateAgentsDirection();

        }

        public void UpdateAgents_OLD()
        {
            // calculate curl noise vector for agents

            Vector3d[] curlNoiseVector = new Vector3d[agentPlanes.Length];

            var p = Partitioner.Create(0, agentPlanes.Length);

            Parallel.ForEach(p, (range, loopState) =>
            {
                for (int i = range.Item1; i < range.Item2; i++)
                {
                    CurlNoise(agentPlanes[i].O, cNS, cNT, true, out curlNoiseVector[i]);
                    curlNoiseVector[i].Unitize();
                    agentPlanes[i].ResetDesired();
                    agentPlanes[i].AlignWithField(curlNoiseVector[i], fI);
                }

            });

            //Parallel.For(0, agentPlanes.Length, i =>
            //{
            //    CurlNoise(agentPlanes[i].O, cNS, cNT, true, out curlNoiseVector[i]);
            //    curlNoiseVector[i].Unitize();
            //    agentPlanes[i].Align(curlNoiseVector[i], mF);
            //});


        }

        public void FLockRTree()
        {
            // define neighborhood radius
            double nR = pR * 3;

            // declare RTree
            RTree rTree = new RTree();

            // populate RTree
            for (int i = 0; i < agentPlanes.Length; i++)
                rTree.Insert(agentPlanes[i].O, i);

            foreach (AgentPlane agent in agentPlanes)
            {
                List<AgentPlane> neighbours = new List<AgentPlane>();

                EventHandler<RTreeEventArgs> rTreeCallback =
                    (object sender, RTreeEventArgs args) =>
                    {
                        if (agentPlanes[args.Id] != agent)
                            neighbours.Add(agentPlanes[args.Id]);
                    };

                rTree.Search(new Sphere(agent.O, nR), rTreeCallback);

                // compute desired vector for each agent
                agent.ComputeDesiredNeighbours(neighbours);
            }

        }

        public void UpdateAgentsDirection()
        {
            // here's one of my mods - update positions and velocities in parallel
            var part = Partitioner.Create(0, agentPlanes.Length);
            Parallel.ForEach(part, (range, loopstate) =>
            {
                for (int i = range.Item1; i < range.Item2; i++)
                {
                    // update at max Force
                    agentPlanes[i].Update(mF);
                }
            });
            //Parallel.ForEach(Agents, agent => { agent.UpdateVelocityAndPosition(); });
            //foreach (FlockAgent agent in Agents) agent.UpdateVelocityAndPosition();
        }

    }


    // ........................................................... Agent ..........
    // ............................................................................
    // ............................................................................
    public class AgentPlane
    {

        // fields
        public Point3d O;
        public Vector3d X, Y, Z;
        public Vector3d desDir; // desired direction - influenced by environmental field and nearby agents' directions
        public Vector3d desPos; // desired position - influenced by environmental movement constraints (es. surface) and neighbour agents
        public AgentPlaneSimulation agentSim;

        // constructor
        public AgentPlane(Point3d O, Vector3d dirX, AgentPlaneSimulation agentSim)
        {
            this.O = O;
            dirX.Unitize();
            this.X = dirX;
            this.agentSim = agentSim;
        }
        // methods

        public void Update(double mF)
        {
            // update position
            O += desPos * mF;
            // update direction
            X = X * (1- mF) + mF * desDir;
            X.Unitize();

        }

        public void ResetDesired()
        {
            desDir = Vector3d.Zero;
            desPos = Vector3d.Zero;
        }

        public void ComputeDesiredNeighbours(List<AgentPlane> neighbours)
        {

            // neighbours interaction
            if (neighbours.Count != 0)
            {

                // ............................ alignment behavior

                // align direction with neighbours
                Vector3d align = Vector3d.Zero;

                foreach (AgentPlane neighbour in neighbours)
                    align += neighbour.X;

                align /= neighbours.Count;

                // updates desired direction
                // multiplies alignment vector by alignment intensity factor
                desDir += agentSim.aI * align;

                // ............................ cohesion behavior
                Vector3d cohesion = Vector3d.Zero;
                foreach (AgentPlane neighbour in neighbours)
                    cohesion += (Vector3d)Point3d.Subtract(neighbour.O, O);

                cohesion /= neighbours.Count;

                // updates desired position
                // multiplies cohesion vector by cohesion intensity factor
                desPos += agentSim.cI * cohesion;


                // ............................ separation behavior
                Vector3d separation = Vector3d.Zero;
                int sepCount = 0;
                double sepDistSq = agentSim.pR * agentSim.pR;
                double distSq;
                foreach (AgentPlane neighbour in neighbours)
                {
                    distSq = O.DistanceToSquared(neighbour.O);
                    if (distSq < sepDistSq)
                    {
                        // separation vector is bigger when closer to another agent
                        separation += (Vector3d)Point3d.Subtract(O, neighbour.O) * (sepDistSq-distSq);
                        sepCount++;
                    }
                }
                if (sepCount > 0)
                    separation /= sepCount;

                // updates desired position
                // multiplies separation vector by separation intensity factor
                desPos += agentSim.sI * separation;

            }

        }

        public void AlignWithField(Vector3d fieldVector, double fI)
        {

            X = X * (1 - fI) + fieldVector * fI;
            X.Unitize();
        }

        public void ComputeFieldAlign(Vector3d fieldVector, double fI)
        {
            desDir += fieldVector * fI;
        }

        public Plane PlaneOut()
        {
            Vector3d oV = new Vector3d(O);
            oV.Unitize();
            this.Y = Vector3d.CrossProduct(X, oV);
            return new Plane(O, X, Y);
        }

        public GH_Mesh MeshOut(double rad)
        {
            Plane pl = PlaneOut();
            Transform x = Transform.PlaneToPlane(Plane.WorldXY, pl);

            Mesh m = new Mesh();
            Point3d[] verts = new Point3d[] { new Point3d(-1, -1, 0), new Point3d(1, -1, 0), new Point3d(1, 1, 0), new Point3d(-1, 1, 0) };
            m.Vertices.AddVertices(verts);
            m.Faces.AddFace(0, 1, 2, 3);
            m.Scale(rad);
            m.Transform(x);
            m.Normals.ComputeNormals();

            GH_Mesh m1 = new GH_Mesh(m);
            return m1;
        }
    }

    // .................................................................. Utilities 
    // .............................................................................
    // 
    // .............................................................................
    // ..................... 3D Curl Noise function ................................
    // .............................................................................

    static void CurlNoise(Point3d P, double S, double t, bool flag, out Vector3d V)
    {
        // . . . . . . . . Points . . scale . .  time . .  3D . . . .  out vectors

        float fS = (float)S;
        float fT = (float)t;
        float nX = (float)P.X * fS + fT; // num5
        float nY = (float)P.Y * fS + fT; // num6
        float nZ = (float)P.Z * fS + fT; // num7

        double num8 = Noise.Generate(nX, nY, nZ);
        float dT = 1f;
        float nPlus = Noise.Generate(nX, nY + dT, nZ);
        float nMinus = Noise.Generate(nX, nY - dT, nZ);
        float nDiff = (nPlus - nMinus) / (2f * dT);
        nPlus = Noise.Generate(nX, nY, nZ + dT);
        nMinus = Noise.Generate(nX, nY, nZ - dT);
        float num13 = (nPlus - nMinus) / (2f * dT);
        float num14 = nDiff - num13;
        nX -= fT;
        nY -= fT;
        nPlus = Noise.Generate(nX, nY, nZ + dT);
        nMinus = Noise.Generate(nX, nY, nZ - dT);
        nDiff = (nPlus - nMinus) / (2f * dT);
        nPlus = Noise.Generate(nX + dT, nY, nZ);
        nMinus = Noise.Generate(nX - dT, nY, nZ);
        num13 = (nPlus - nMinus) / (2f * dT);
        float num15 = nDiff - num13;
        nPlus = Noise.Generate(nX + dT, nY, nZ);
        nMinus = Noise.Generate(nX - dT, nY, nZ);
        nDiff = (nPlus - nMinus) / (2f * dT);
        nPlus = Noise.Generate(nX, nY + dT, nZ);
        nMinus = Noise.Generate(nX, nY - dT, nZ);
        num13 = (nPlus - nMinus) / (2f * dT);
        float num16 = nDiff - num13;
        Vector3d val2 = new Vector3d((double)num14, (double)num15, (double)num16);
        if (!flag)
        {
            nPlus = Noise.Generate(nX, nY + dT);
            nMinus = Noise.Generate(nX, nY - dT);
            nDiff = (nPlus - nMinus) / (2f * dT);
            nPlus = Noise.Generate(nX + dT, nY);
            nMinus = Noise.Generate(nX - dT, nY);
            nDiff = (nPlus - nMinus) / (2f * dT);
            val2 = new Vector3d((double)nDiff, (double)(0f - num13), 0.0);
        }
        V = val2;

    }

    public float Remap(float val, float from1, float to1, float from2, float to2)
    {
        return (val - from1) / (to1 - from1) * (to2 - from2) + from2;
    }

    public GH_Colour Vec2Col(Vector3d v)
    {
        v.Unitize();
        int red = (int)Math.Floor(Remap((float)v.X, -1f, 1f, 0f, 255f));
        int green = (int)Math.Floor(Remap((float)v.Y, -1f, 1f, 0f, 255f));
        int blue = (int)Math.Floor(Remap((float)v.Z, -1f, 1f, 0f, 255f));
        return new GH_Colour(Color.FromArgb(red, green, blue));
    }
# ---------- end c_script_2 ----------

# ----
ftsv2 = FileToScriptV2(File=path)  # disabled
curl_2 = CurlNoise(Points=c_script_2.Planes, Scale=number_slider_2, Offset=number_slider, _3D="true")  # -> CurlVector, Colour
generic_messages = Panel(c_script_2.out)

# ---- group: movement
ln = Line(StartPoint=pt, EndPoint=c_script_2.Planes)

# ---- group: curl noise for comparison
vec_2 = Vector(curl_2.CurlVector)

# ----
deplane = DeconstructPlane(Plane=c_script_2.Planes)  # -> Origin, XAxis, YAxis, ZAxis
number_slider_3 = Slider(0.25, range=0..1)
unit = UnitVector(Vector=vec_2)
amp_2 = Amplitude(Vector=vec_2, Amplitude=number_slider_3)
amp_3 = Amplitude(Vector=deplane.XAxis, Amplitude=number_slider_3)
angle = Angle(VectorA=vec_2, VectorB=deplane.XAxis)  # -> Angle, Reflex
vdisex_2 = VectorDisplayEx(Point=deplane.Origin, Vector=amp_2, Colour=unit, Width="1")
vdisex_3 = VectorDisplayEx(Point=deplane.Origin, Vector=amp_3, Colour=RGB(0, 0, 0), Width="1")
vlen = VectorLength(Vector=vec_2)

# ---- group: alignment check
alignment_control = QuickGraph(angle.Angle, SortOrder=0)

# ----
cluster = Cluster(plane=c_script_2.Planes, plane_radius=Slider(0.248, range=0..1))
bar_graph = BarGraph(vlen, BarColor=RGB(255, 0, 90))
preview = CustomPreview(Geometry=cluster, Material=ColourSwatch(SwatchColor=RGB(255, 255, 255)))

# ---- group: planes
pln = Plane([Plane(origin=(1.474328107, 2.160024018, 5.615213892), x=(-0.1865894699, -0.7351937955, 0.6516705094), y=(-0.9338197826, 0.3388055817, 0.1148537831)), Plane(origin=(7.658070654, 8.459481986, 8.69302647), x=(0.4541280339, -0.6253996993, 0.6345415235), y=(-0.7796196314, 0.06577942337, 0.6227891278)), Plane(origin=(8.966400618, 1.478651276, 5.01224606), x=(0.1260710609, -0.8764848169, -0.4646293719), y=(-0.3678952135, -0.4762764286, 0.7986325034)), Plane(origin=(9.103959644, 8.298121961, 1.018538834), x=(0.5419696305, 0.3165246522, -0.7785120835), y=(0.6557680296, -0.7386242956, 0.1562128077)), Plane(origin=(0.8938060131, 8.311752002, 0.8848503503), x=(0.7310695223, -0.6506179803, 0.2055081442), y=(-0.3237627596, -0.06566497395, 0.9438568677)), Plane(origin=(5.207132034, 1.383491047, 9.084349553), x=(-0.3303202592, 0.568700245, -0.7533050894), y=(0.8686820927, -0.1289793744, -0.4782841653))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])

# ----
subdir_2 = Panel("Agent_Bodies\Agent_Bodies")
cs_file_to_sync_2 = Panel("Planes2Bodies.cs")
dir_type_2 = ValueList({"desktop": 0, "documents": 1, "GH file path": 2, "C:": 3}, selected="GH file path")
item = ListItem(List=pln, Index=Slider(13, range=0..20), Wrap=True)
f_pathg_2 = PathGenerator(type=dir_type_2, subDir=subdir_2)  # -> dir; inputs type: Int32, subDir: String; same code as f_pathg

# ---- group: body
crv = Curve([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])

# ----
concat_2 = Concatenate(FragmentA=f_pathg_2, FragmentB=cs_file_to_sync_2)
scale = Scale(Geometry=crv, Center=Point(0, 0, 0), Factor=Slider(1.1, range=0..3))  # -> Geometry, Transform
pln_2 = Plane(pln)
cir = Circle(Plane=PlaneXY(0, 0, 0), Radius=Slider(1, range=0..3))
crv_2 = Curve(cir)
reset = Button()
go = BooleanToggle(False)
path_2 = FilePath(concat_2)

# ---- group: agent bodies
c_script_3 = CSharpScript(reset=reset, go=go, Pl=pln_2, body=scale.Geometry)  # -> out, Bodies, Planes, TipPoints; inputs reset: Boolean, go: Boolean, Pl: list of Plane, id: list of Int32, body: list of Polyline
# ---------- c_script_3: C# usings ----------
 
using System.Threading;
using System.Threading.Tasks;
using System.Collections.Concurrent;
using System.Drawing;
# ---------- c_script_3: C# ----------
 

        // . . . . . . . . . . . . . . . . . . . . . . . . return on null data
        if (Pl == null || body == null) return;

        // variables for data extraction
        DataTree<Polyline> outBodies = new DataTree<Polyline>();
        GH_Plane[] outPlanes = new GH_Plane[Pl.Count];
        List<GH_Point> tipPoints = new List<GH_Point>();

        // . . . . . . . . . . . . . . . . . . . . . . . . initialize system
        if (reset || ABS == null)
        {
            ABS = new AgentBodySimulation(Pl, body);
        }

        Print("{0}", ABS.Agents[0].Neighbours.Count);
        Print(Status);

        if (go)
        {
            ABS.Run();
            Component.ExpireSolution(true);
        }


        // . . . . . . . . . . . . . . . . . . . . . . . . extract geometries and data

        // necessary only in case of parallelization
        //for (int i = 0; i < ABS.Agents.Length; i++)
        //    outBodies.EnsurePath(new GH_Path(i));

        for (int i = 0; i < ABS.Agents.Length; i++)
        {
            outBodies.AddRange(ABS.Agents[i].ExtractBody(), new GH_Path(i));
            outPlanes[i] = new GH_Plane(ABS.Agents[i].agentPlane);
            for (int j = 0; j < ABS.Agents[i].body.Tips.Count; j++)
                tipPoints.Add(new GH_Point(ABS.Agents[i].body.Tips[j].pos));
        }

        Bodies = outBodies;
        Planes = outPlanes;
        TipPoints = tipPoints;
# ---------- c_script_3: C# additional code ----------
 

    // global variables
    public AgentBodySimulation ABS;
    public static string Status = ""; // for debugging

    // .................................................................... classes 
    // .............................................................................
    // .............................................................................

    // ...................................................... Simulation ..........
    // ............................................................................
    // ............................................................................
    public class AgentBodySimulation
    {
        public AgentBody[] Agents;
        RTree agentsRTree;
        public double searchRadius;

        public AgentBodySimulation(List<Plane> Pl, List<Polyline> body)
        {
            Agents = new AgentBody[Pl.Count];
            agentsRTree = new RTree();
            searchRadius =  0.5f; // this can be later externalized as a parameter

            // . . . . . . . . . . . . . . . . . . . . . . . . build agents array & RTree
            // since agents are fixed it can be built in advance
            for (int i = 0; i < Pl.Count; i++)
            {
                Agents[i] = new AgentBody(Pl[i], body);
                agentsRTree.Insert(Agents[i].agentPlane.Origin, i);
            }

            // . . . . . . . . . . . . . . . . . . . . . . . . . . . build neighbours map
            FindNeighbours(searchRadius);
        }

        public AgentBodySimulation() { }

        public void Run()
        {
            // foreach (AgentBody ab in Agents)
            Parallel.ForEach(Agents, ab =>
            {
                ab.Update();
            });

            // call tips UpdatePosition
            Parallel.ForEach(Agents, ab =>
            {
                foreach (Tip t in ab.body.Tips) t.UpdatePosition();
            });

            // rebuild bodies
            Parallel.ForEach(Agents, ab =>
            {
                ab.RebuildBody();
            });
        }

        public void FindNeighbours(double searchRadius)
        {

            foreach (AgentBody ab in Agents)
            {
                EventHandler<RTreeEventArgs> rTreeCallback = (object sender, RTreeEventArgs args) =>
                {
                    if (Agents[args.Id] != ab)
                        ab.Neighbours.Add(Agents[args.Id]);

                };

                agentsRTree.Search(new Sphere(ab.body.O, searchRadius), rTreeCallback);
            }
        }
    }

    // ...................................................... Agent Body ..........
    // ............................................................................
    // ............................................................................

    public class AgentBody
    {
        public Plane agentPlane;
        public Body body;
        public List<AgentBody> Neighbours;
        public AgentBodySimulation ABS;

        public AgentBody(Plane agentPlane, List<Polyline> polylines)
        {
            // define agent body and orient it
            this.agentPlane = agentPlane;
            body = new Body(polylines);
            OrientBody(Plane.WorldXY, this.agentPlane);

            Neighbours = new List<AgentBody>(); // this list will be filled later by the simulation
        }

        public void OrientBody(Plane oldPlane, Plane newPlane)
        {
            var x = Transform.PlaneToPlane(oldPlane, newPlane);

            body.O.Transform(x);

            for (int i = 0; i < body.Arms.Count; i++)
                body.Arms[i].Transform(x);

            for (int i = 0; i < body.Tips.Count; i++)
                body.Tips[i].pos.Transform(x);
        }

        public void RebuildBody()
        {
            for(int i=0; i< body.Arms.Count; i++)
            {
                body.Arms[i][body.Arms[i].Count - 1] = body.Tips[i].pos;
            }

        }

        public void Update()
        {
            TipsCohesion();
        }

        public void TipsCohesion()
        {
            List<Tip> nearTips = new List<Tip>();

            // search neighbour agents and add tips to neighbours tips list (do it at every iteration since tips can move)
            foreach (AgentBody nearAg in Neighbours)
                nearTips.AddRange(nearAg.body.Tips);

            // call tips ComputeDesired
            foreach (Tip t in body.Tips) t.ComputeDesired(nearTips);
        }

        public void UpdateArms()
        {

        }

        public List<Polyline> ExtractBody()
        {
            return body.Arms;
        }

    }

    // ............................................................ Body ..........
    // ............................................................................
    // ............................................................................
    public class Body
    {
        public List<Polyline> Arms;
        public List<Tip> Tips;
        public Point3d O;
        public Body(List<Polyline> polylines)
        {
            // ATTENTION - typical reference type mistake - shallow vs deep copies
            // this is a shallow copy, so it references always the same PolyLine list!
            //Arms = new List<Polyline>(polylines); 

            // this makes a deep copy - CORRECT
            Arms = new List<Polyline>();
            foreach (Polyline p in polylines)
                Arms.Add(p.Duplicate());

            O = Arms[0][0];

            Tips = new List<Tip>();
            foreach (Polyline arm in Arms)
                Tips.Add(new Tip(this, arm[arm.Count - 1]));
        }
    }

    // ............................................................. Tip ..........
    // ............................................................................
    // ............................................................................
    public class Tip
    {
        public Body body;
        public Point3d pos;
        public Vector3d desired;
        public double cR;
        public double cI;
        public double angleOfVis;

        public Tip(Body body, Point3d pos, double cR, double cI, double angleOfVis)
        {
            this.body = body;
            this.pos = pos;
            this.cR = cR;
            this.cI = cI;
            this.angleOfVis = angleOfVis;
            desired = Vector3d.Zero;
        }

        // constructor chaining example
        public Tip(Body body, Point3d pos) : this(body, pos, 0.5f, 0.01f, Math.PI * 0.5) { }

        public void ComputeDesired(List<Tip> neighbourTips)
        {
            // reset desired vector
            desired = Vector3d.Zero;
            // if neighbour tips list is zero or null return
            if (neighbourTips == null || neighbourTips.Count == 0) return;

            Vector3d cohesion = Vector3d.Zero;
            double nTipCount = 0.0;
            double distSq, angle;
            Vector3d toTip, toNTip;
            // search neighbour tips list
            foreach (Tip nTip in neighbourTips)
            {
                distSq = pos.DistanceToSquared(nTip.pos);
                //  if tip in radius 
                if (distSq < cR)
                {
                    //   then if tip in angle of vision
                    toTip = pos - body.O;
                    toNTip = nTip.pos - body.O;
                    angle = Vector3d.VectorAngle(toTip, toNTip);
                    if (angle < angleOfVis)
                    {
                        //     add to cohesion vector and increase counter
                        cohesion += toNTip;
                        nTipCount++;
                    }
                }
            }
            // if found tips number > 0
            if (nTipCount > 0)
            {
                // average cohesion vector
                cohesion /= nTipCount;
                // desired is cohesion
                desired = cohesion;
            }

        }

        public void UpdatePosition()
        {
            pos += desired * cI;
            // limit tip position to a max reach
            Vector3d toTip = pos - body.O;
            if (toTip.SquareLength > 1f)
            {
                toTip = Limit(toTip, 1f);
                pos = body.O + toTip;
            }
        }
    }

    // .................................................................. Utilities 
    // .............................................................................

    public static Vector3d Limit(Vector3d v, double length)
    {
        Vector3d rv = new Vector3d(v);
        double len = rv.Length;
        if (len > length)
        {
            rv.Unitize();
            rv *= length;
        }
        return rv;
    }
# ---------- end c_script_3 ----------

# ---- group: agent bodies orient only
c_script_4 = CSharpScript(Pl=pln_2, body=scale.Geometry)  # -> out, Bodies, Planes; inputs Pl: list of Plane, id: list of Int32, body: list of Polyline; disabled
# ---------- c_script_4: C# ----------
 

        if (Pl == null) return;

        DataTree<Polyline> outBodies = new DataTree<Polyline>();
        GH_Plane[] outPlanes = new GH_Plane[Pl.Count];

        if (Agents == null)
        {
            Agents = new AgentBody[Pl.Count];

            // build agents array

            for (int i = 0; i < Pl.Count; i++)
                Agents[i] = new AgentBody(Pl[i], body);

        }

        
        // extract geometries and data

        for (int i = 0; i < Agents.Length; i++)
            outBodies.EnsurePath(new GH_Path(i));

        List<Polyline> arms;
        for (int i = 0; i < Agents.Length; i++)
        {
            arms = Agents[i].ExtractBody();
            outBodies.AddRange(arms, new GH_Path(i));
            outPlanes[i] = new GH_Plane(Agents[i].agentPlane);
        }

        Bodies = outBodies;
        Planes = outPlanes;
# ---------- c_script_4: C# additional code ----------
 

    // global variables
    AgentBody[] Agents;


    public class AgentBody
    {
        public Plane agentPlane;
        public Body agentBody;


        public AgentBody(Plane agentPlane, List<Polyline> polylines)
        {
            this.agentPlane = agentPlane;
            agentBody = new Body(polylines);
            OrientBody(Plane.WorldXY, this.agentPlane);
        }

        public void OrientBody(Plane oldPlane, Plane newPlane)
        {
            var x = Transform.PlaneToPlane(oldPlane, newPlane);

            Polyline newArm;

            for (int i = 0; i < agentBody.Arms.Count; i++)
            {
                newArm = new Polyline(agentBody.Arms[i]);
                newArm.Transform(x);
                agentBody.Arms[i] = newArm;
            }
        }

        public List<Polyline> ExtractBody()
        {
            return agentBody.Arms;
        }

    }

    // . . . . . . . . . . . . . . . body class
    public class Body
    {
        public List<Polyline> Arms;
        public List<Point3d> Tips;
        public Point3d O;
        public Body(List<Polyline> polylines)
        {

            Arms = new List<Polyline>(polylines);
            //Arms.AddRange(polylines);
            O = Arms[0][0];

            Tips = new List<Point3d>();
            foreach (Polyline p in Arms)
            {
                Tips.Add(p[p.Count - 1]);
            }
        }
    }
# ---------- end c_script_4 ----------

# ----
orient = Orient(Geometry=scale.Geometry, Source=PlaneXY(0, 0, 0), Target=graft(pln_2))  # -> Geometry, Transform
ftsv2_2 = FileToScriptV2(File=path_2)

# ---- group: orient needs copies!!
c_script_5 = CSharpScript(x=pln_2, y=scale.Geometry)  # -> out, A; inputs x: list of Plane, y: list of Polyline
# ---------- c_script_5: C# ----------
    DataTree <Polyline> outPoly = new DataTree<Polyline>();

    for(int i = 0; i < x.Count; i++)
    {
      var tr = Transform.PlaneToPlane(Plane.WorldXY, x[i]);
      Polyline y2;
      for(int j = 0; j < y.Count; j++)
      {
        // I must:
        // . make a copy of the polyline
        // . transform it
        // . assign the transformed copy to the original variable
        y2 = new Polyline(y[j]);
        y2.Transform(tr);
        outPoly.Add(y2, new GH_Path(i));
      }
    }

    A = outPoly;
# ---------- end c_script_5 ----------

# ----
panel_3 = Panel(c_script_3.out)
crv_3 = Curve(c_script_3.Bodies)
pln_3 = Plane(c_script_3.Planes)

# ---- group: read-write data
input = DataInput(
    Destination="F:\Users\alessio\Documents\Co-de-iT\Design By Data Master Paris\2019\workshop\bodies-planes.ghdata",
    RelativePath="F:\Users\alessio\Documents\Co-de-iT\Design By Data Master Paris\2019\workshop\bodies-planes.ghdata|bodies-planes.ghdata",
    UpdateDelay=5)  # -> Bodies, Planes; disabled
output = DataOutput(
    Bodies=crv_3,
    Planes=pln_3,
    Destination="F:\Users\alessio\Documents\Co-de-iT\Design By Data Master Paris\2019\workshop\bodies-planes.ghdata",
    RelativePath="F:\Users\alessio\Documents\Co-de-iT\Design By Data Master Paris\2019\workshop\bodies-planes.ghdata|bodies-planes.ghdata")  # disabled

# ----
crv_4 = Curve(orient.Geometry)
crv_5 = Curve(c_script_5.A)  # disabled
pt_2 = Point(c_script_3.TipPoints)
orient_2 = Orient(Geometry=crv_3, Source=graft(pln_3), Target=PlaneXY(0, 0, 0))  # -> Geometry, Transform; disabled
crv_6 = Curve(simplify(Tree({0}: [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], {1}: [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], {2}: [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], {3}: [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], {4}: [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], {5}: [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]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)))
list = ValueList({"Imported": 0, "From file": 1}, selected="Imported")
input_2 = DataInput(
    Destination="F:\Users\alessio\Documents\Co-de-iT\Design By Data Master Paris\2019\workshop\bodies-planes.ghdata",
    RelativePath="F:\Users\alessio\Documents\Co-de-iT\Design By Data Master Paris\2019\workshop\bodies-planes.ghdata|bodies-planes.ghdata",
    UpdateDelay=5)  # -> Bodies, Planes; disabled
filter = StreamFilter(Gate=list, Stream0=crv_6, Stream1=input_2.Bodies)  # disabled

# ---- group: point for selection
pt_3 = Point(Point(2.354573578, 5.564390926, 4.62768902))

# ----
radius_multiplier = Slider(1.85, range=1.5..3)
list_2 = ValueList({"Gaussian": 0, "Laplacian": 1, "Mean": 2, "Median": 3}, selected="Mean")

# ----
# in case of invalid mesh output: 1. try to increase the Isovalue to 0.001 or 0.002
# 
# 2. if that doesn't do the trick, increase the radius multiplier
crv_7 = Curve(simplify(Tree({0}: [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], {1}: [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], {2}: [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], {3}: [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], {4}: [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], {5}: [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]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)))
end = EndPoints(Curve=filter)  # -> Start, End
# post processing (Dendro)
item_2 = ListItem(List=end.Start, Index=0, Wrap=True)  # -> flatten(Item)
list_3 = ValueList({"All data": 0, "Partial list": 1}, selected="All data")
number_slider_4 = Slider(0.03, range=0.01..1)
number_slider_5 = Slider(0.05, range=0..5)
dir_type_3 = ValueList({"desktop": 0, "documents": 1, "GH file path": 2, "C:": 3}, selected="GH file path")
vsettings = CreateSettings(
    VoxelSize=number_slider_4,
    Bandwidth=Slider(0.5, range=0..3),
    Isovalue=Slider(0, range=0..1),
    Adaptivity=Slider(0.6, range=0..1))
f_pathg_3 = PathGenerator(type=dir_type_3)  # -> dir; inputs type: Int32, subDir: String; same code as f_pathg
one_over_x = OneOverX(Value=number_slider_4)
cs_file_to_save = Panel("Volume_complete.vdb")
cs_file_to_read = Panel("Volume01.vdb")

# ---- group: find neighbours (RTree)
c_script_6 = CSharpScript(P=item_2, P0=pt_3, radius=Slider(4, range=0..10))  # -> out, A, B; inputs P: list of Point3d, P0: Point3d, radius: Double
# ---------- c_script_6: C# ----------
    if (P == null || P.Count == 0) return;

    pts = P;
    cl.Clear();
    ci.Clear();

    // declare RTree
    RTree tree = new RTree();

    // poopulate it
    for(int i = 0; i < P.Count; i++)
      tree.Insert(P[i], i);

    // perform search
    
    // option 1.1: EventHandler declared on the fly
    EventHandler<RTreeEventArgs> rTreeCallback = (object sender, RTreeEventArgs e) =>
      {
      cl.Add(pts[e.Id]);
      ci.Add(e.Id);
      };
    // option 1.1 & 1.2: call to external function
    tree.Search(new Sphere(P0, radius), rTreeCallback);

    //    option 2: use embedded anonymous function with lambda syntax
    //    tree.Search(new Sphere(P0, radius), (object sender, RTreeEventArgs e) =>
    //      {
    //      cl.Add(pts[e.Id]);
    //      ci.Add(e.Id);
    //      });

    A = cl;
    B = ci;
# ---------- c_script_6: C# additional code ----------
  List<Point3d> cl = new List<Point3d>();
  List<int> ci = new List<int>();
  List<Point3d> pts = new List<Point3d>();


  // option 1.2: declare callback function as an external one
  //  private void rTreeCallback(object sender, RTreeEventArgs e){
  //    cl.Add(pts[e.Id]);
  //    ci.Add(e.Id);
  //  }
# ---------- end c_script_6 ----------

# ----
multiplication = Multiplication(A=radius_multiplier, B=number_slider_4)
concat_3 = Concatenate(FragmentA=f_pathg_3, FragmentB=cs_file_to_save)
concat_4 = Concatenate(FragmentA=f_pathg_3, FragmentB=cs_file_to_read)

branch = TreeBranch(Tree=filter, Path=c_script_6.B, MaintainPaths=True)
filter_2 = StreamFilter(Gate=list_3, Stream0=filter, Stream1=branch)  # -> flatten(Stream)
bbox = BoundingBox(Content=filter_2, Plane=PlaneXY(0, 0, 0), UnionBox=True)  # -> Box, Box_2
boxprop = BoxProperties(Box=bbox.Box)  # -> Center, Diagonal, Area, Volume, Degeneracy
vcurve = CurveToVolume(Curves=filter_2, CurveRadius=multiplication, Settings=vsettings)
vsmooth = SmoothVolume(Volume=vcurve, Width=1, Type=list_2, Iterations=Slider(1, range=1..10))
vread = ReadVolume(FilePath=concat_4, Read=Button())  # disabled
vwrite = WriteVolume(Volume=vcurve, FilePath=concat_3, Write=Button())

c_script_7 = CSharpScript(D=boxprop.Diagonal, s=one_over_x)  # -> out, A; inputs D: Vector3d, s: Double
# ---------- c_script_7: C# ----------
    int x,y,z,t;

    x = (int) Math.Floor(D.X * s);
    y = (int) Math.Floor(D.Y * s);
    z = (int) Math.Floor(D.Z * s);
    t = x * y * z;

    A = String.Format("{0:0,0} Cells\n\n X: {1}\n Y: {2}\n Z: {3}", t, x, y, z);
# ---------- end c_script_7 ----------
mvolume = VolumeToMesh(Volume=vsmooth, VolumeSettings=vsettings)

panel_4 = Panel(c_script_7.A)
meshpreview = MeshPreview(Mesh=mvolume)
preview_2 = CustomPreview(Geometry=mvolume, Material=ColourSwatch(SwatchColor=RGB(255, 255, 255)))  # disabled

panel_5 = Panel(mvolume)

# ----
# the position sets the origin, the orientation vector is the X axis and the cross product between orientation vector and origin point is the Y
vec_3 = Vector()
pt_4 = Point()
plane_radius_2 = Slider(0.5, range=0..1)
pln_4 = Plane([Plane(origin=(1.107439772, 2.486685842, 5.329893201), x=(-0.4986065825, -0.3737708271, 0.7821041137), y=(0.736199743, -0.658904909, 0.1544482416)), Plane(origin=(7.737039969, 8.564648134, 9.111530999), x=(0.6313497429, -0.6177262295, 0.4688409193), y=(0.6797393374, 0.1497869656, -0.7179960293)), Plane(origin=(9.516898365, 0.960044973, 5.174120513), x=(0.06754764495, -0.7872200112, -0.6129616379), y=(0.3361304946, 0.596404943, -0.7289152451)), Plane(origin=(9.451836482, 8.611707454, 0.2795030085), x=(0.5822428151, 0.3774502994, -0.7200865058), y=(-0.6631927726, 0.7328285453, -0.1521107148)), Plane(origin=(0.1268575574, 8.683155635, 0.3600956688), x=(0.6474369355, -0.7273328192, 0.2276233394), y=(0.3645451364, 0.03326631567, -0.9305913151)), Plane(origin=(5.100827089, 1.020646925, 9.849754767), x=(-0.2654628733, 0.2418112793, -0.9333042205), y=(-0.7862234292, 0.5059869432, 0.3547251511))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])
number_slider_6 = Slider(0.177, range=0..1)
amp_4 = Amplitude(Vector=vec_3, Amplitude=number_slider_6)
vdisex_4 = VectorDisplayEx(Point=pt_4, Vector=amp_4, Colour=ColourSwatch(SwatchColor=RGB(255, 0, 0)), Width=2)

# ---- group: plane Y vector
xprod = CrossProduct(VectorA=pt_4, VectorB=vec_3, Unitize=True)  # -> Vector, Length

# ---- group: plane Z vector
xprod_2 = CrossProduct(VectorA=vec_3, VectorB=xprod.Vector, Unitize=True)  # -> Vector, Length

# ---- group: plane
pl = ConstructPlane(Origin=pt_4, XAxis=vec_3, YAxis=xprod.Vector)

# ---- group: mesh plane
cluster_2 = Cluster(plane=pl, plane_radius=plane_radius_2)

# ----
amp_5 = Amplitude(Vector=xprod.Vector, Amplitude=number_slider_6)
vdisex_5 = VectorDisplayEx(Point=pt_4, Vector=amp_5, Colour=ColourSwatch(SwatchColor=RGB(53, 212, 0)), Width=2)
preview_3 = CustomPreview(Geometry=cluster_2, Material=xprod_2.Vector)
preview_4 = CustomPreview(Geometry=cluster_2, Material=ColourSwatch(SwatchColor=RGB(255, 255, 255)))

# ==== cluster Cluster
plane_radius = ClusterInput()
plane = ClusterInput()

# ---- group: create a mesh quad face
panel = Panel("""{-1,-1,0}
{1,-1,0}
{1,1,0}
{-1,1,0}""")
conmesh = ConstructMesh(Vertices=panel, Faces={A=0, B=1, C=2, D=3})
scale = Scale(Geometry=conmesh, Center=Point(0, 0, 0), Factor=plane_radius)  # -> Geometry, Transform

# ----
orient = Orient(Geometry=scale.Geometry, Source=PlaneXY(0, 0, 0), Target=plane)  # -> Geometry, Transform
mesh_plane = ClusterOutput(orient.Geometry)
